# Grasshopper definition assignment-01.gh (Grasshopper 1.0.8)

# Assignment-01: Bauhaus
number_slider = Slider(0, range=0..2)
list = ValueList({"Crown": 0.1, "Cascade": 0.5, "Orbit": 0.9}, selected="Orbit")
py3 = Python3Script(tension=list, style=number_slider, seed=Slider(28, range=1..101), time=Slider(360, range=0..360))  # -> red, yellow, blue, black, white, bulb, info
# ---------- py3: Python ----------
#! python 3
# Rhino 8 "Python 3 Script" component. Add inputs gradually: any input you have not created is simply skipped.
#
# INPUTS (Item Access, No Type Hint)
#  master:     tension, style, seed, follow, time
#  structure:  tiers, ring_min, ring_max, top_drop, gap
#  motion:     tilt, spin_speed
#  rhythm:     wave_amp, wave_freq, drop_base
#  population: items, bulb_ratio, w_cube, w_cylinder, w_prism
#  scale:      size_base, ring_tube, string_radius
#  frame:      count_scale, spoke_step, spacing
# OUTPUTS: red, yellow, blue, black, white, bulb, info
import sys
import importlib

SRC = r"C:\path\to\cdf1_teaching\src"   # <-- your path
if SRC not in sys.path:
    sys.path.append(SRC)

from cdf import geometry_basics as gb
importlib.reload(gb)


INPUT_NAMES = [
    "tension", "style", "seed", "follow", "time",
    "tiers", "ring_min", "ring_max", "top_drop", "gap",
    "tilt", "spin_speed",
    "wave_amp", "wave_freq", "drop_base",
    "items", "bulb_ratio", "w_cube", "w_cylinder", "w_prism",
    "size_base", "ring_tube", "string_radius",
    "count_scale", "spoke_step", "spacing",
]

# Look inputs up by NAME (strings), so inputs you have not created yet are not "undefined names".
_scope = globals()
kwargs = {n: _scope.get(n) for n in INPUT_NAMES if _scope.get(n) is not None}

if "tension" not in kwargs:
    raise ValueError("No 'tension' input found: create it (and wire a value) or check its exact name.")

res, info = gb.bauhaus_chandelier(**kwargs)

red, yellow, blue = res["red"], res["yellow"], res["blue"]
black, white, bulb = res["black"], res["white"], res["bulb"]
# ---------- end py3 ----------
preview = CustomPreview(Geometry=py3.red, Material=ColourSwatch(SwatchColor=RGB(212, 2, 2)))
preview_2 = CustomPreview(Geometry=py3.yellow, Material=ColourSwatch(SwatchColor=RGB(245, 209, 7)))
preview_3 = CustomPreview(Geometry=py3.black, Material=ColourSwatch(SwatchColor=RGB(0, 0, 0)))
preview_4 = CustomPreview(Geometry=py3.white, Material=ColourSwatch(SwatchColor=RGB(255, 255, 255)))
preview_5 = CustomPreview(Geometry=py3.blue, Material=ColourSwatch(SwatchColor=RGB(0, 76, 255)))
preview_6 = CustomPreview(Geometry=py3.bulb, Material=ColourSwatch(SwatchColor=RGB(255, 204, 0)))
